# Grasshopper definition 001_Move_4.2.gh (Grasshopper 1.0.7)
# plug-ins: Bifocals

geometry = Geometry(<brep referenced from the Rhino model>)
geometry_2 = Geometry(<brep referenced from the Rhino model>)
deconstruct_brep = DeconstructBrep(Brep=geometry)  # -> Faces, Edges, Vertices
deconstruct_brep_2 = DeconstructBrep(Brep=geometry_2)  # -> Faces, Edges, Vertices
list_item = ListItem(List=deconstruct_brep.Faces, Index=Slider(2, range=0..2), Wrap=True)
list_item_2 = ListItem(List=deconstruct_brep_2.Faces, Index=Slider(1, range=0..2), Wrap=True)
area = Area(Geometry=list_item_2)  # -> Area, Centroid
area_2 = Area(Geometry=list_item)  # -> Area, Centroid
orient = Orient(Geometry=geometry_2, Source=area.Centroid, Target=area_2.Centroid)  # -> Geometry, Transform
c_script = CSharpScript()  # -> Out, A
ghpython_script = GhPythonScript()  # -> Out, A
