# Grasshopper definition 002_Move_4.3-4.4.gh (Grasshopper 1.0.7)

point = Point([Point(-40.2150151, 26.69752043, 15.71257783), Point(-31.26037698, -27.49846421, 15.71257783), Point(17.40358906, -27.49846421, 15.71257783), Point(33.16492199, -9.398175364, 15.71257783), Point(19.02209624, 26.60267905, 15.71257783)])
line = Line([Line((-40.2150151, 26.69752043, 0), (-31.26037698, -27.49846421, 0)), Line((-31.26037698, -27.49846421, 0), (17.40358906, -27.49846421, 0)), Line((17.40358906, -27.49846421, 0), (33.16492199, -9.398175364, 0)), Line((33.16492199, -9.398175364, 0), (19.02209624, 26.60267905, 0))])
interpolate = Interpolate(Vertices=point, Degree=3, Periodic=False, KnotStyle=1)  # -> Curve, Length, Domain
end_points = EndPoints(Curve=interpolate.Curve)  # -> Start, End
end_points_2 = EndPoints(Curve=line)  # -> Start, End
line_2 = Line(StartPoint=end_points_2.Start, EndPoint=end_points.Start)
line_3 = Line(StartPoint=end_points.End, EndPoint=end_points_2.End)
ghpython_script = GhPythonScript()  # -> Out, A
c_script = CSharpScript()  # -> Out, A
