# Grasshopper definition 003_SelectionOptions_5.2.gh (Grasshopper 1.0.7)

curve = Curve([<curve referenced from the Rhino model> x4])
geometry = Geometry([<brep referenced from the Rhino model> x2])
surface = Surface(<surface referenced from the Rhino model>)
list_length = ListLength(List=curve)
curve_2 = Curve(<curve referenced from the Rhino model>)
deconstruct_brep = DeconstructBrep(Brep=surface)  # -> Faces, Edges, Vertices
param_viewer = ParamViewer(geometry)
panel = Panel(geometry)
dispatch = Dispatch(List=geometry, DispatchPattern=[True, False])  # -> ListA, ListB
range = Range(Domain=Slider(8, range=0..10), Steps=expr("x-1", list_length))
panel_2 = Panel(list_length)
param_viewer_2 = ParamViewer(curve)
point = Point(deconstruct_brep.Vertices)
curve_3 = Curve(deconstruct_brep.Edges)
surface_2 = Surface(deconstruct_brep.Faces)
deconstruct_brep_2 = DeconstructBrep(Brep=dispatch.ListA)  # -> Faces, Edges, Vertices
unit_z = UnitZ(Factor=range)
point_on_curve = PointOnCurve(curve_3, parameter=0.323)
move = Move(Geometry=curve_2, Motion=unit_z)  # -> Geometry, Transform
line = Line(StartPoint=point_on_curve, EndPoint=point)
list_item = ListItem(List=deconstruct_brep_2.Faces, Index=Slider(1, range=0..2), Wrap=True)  # -> Item, Item1, Item2
list_item_2 = ListItem(List=deconstruct_brep_2.Edges, Index=Slider(1, range=0..2), Wrap=True)  # -> Item, Item1, Item2
geometry_2 = Geometry(list_item.Item2)
geometry_3 = Geometry(list_item.Item)
geometry_4 = Geometry(list_item.Item1)
curve_4 = Curve(list_item_2.Item1)
ghpython_script = GhPythonScript()  # -> Out, A
c_script = CSharpScript()  # -> Out, A
area = Area(Geometry=geometry_3)  # -> Area, Centroid
area_2 = Area(Geometry=geometry_2)  # -> Area, Centroid
point_on_curve_2 = PointOnCurve(curve_4, parameter=0.763)
line_2 = Line(StartPoint=area.Centroid, EndPoint=point_on_curve_2)
pipe = Pipe(Curve=line_2, Radius=1, Caps=2)
ghpython_script_2 = GhPythonScript()  # -> Out, A
c_script_2 = CSharpScript()  # -> Out, A
