# Grasshopper definition 004_PrecisionModeling_6.1.gh (Grasshopper 1.0.7)

unit_y = UnitY(Factor=1)
unit_z = UnitZ(Factor=1)
unit_x = UnitX(Factor=1)
vector_xyz = VectorXYZ(XComponent=Slider(4, range=0..10), YComponent=Slider(0, range=0..10), ZComponent=Slider(0, range=0..10))  # -> Vector, Length
construct_point = ConstructPoint(XCoordinate=Slider(0, range=0..10), YCoordinate=Slider(0, range=0..10), ZCoordinate=Slider(0, range=0..10))
construct_domain = ConstructDomain(DomainStart=0, DomainEnd=Slider(2, range=0..2))
length = Length(1)
point = Point([Point(-11, 0, 0), Point(-13, 2, 0), Point(-5, 2, 0), Point(-4, 1, 0), Point(7, 1, 0), Point(7, 2, 0), Point(12, 0, 0)])
start = Start(construct_point)
curve = Curve(<curve referenced from the Rhino model>)
range = Range(Domain=construct_domain, Steps=10)
panel = Panel(start)
interpolate = Interpolate(Vertices=point, Degree=3, Periodic=False, KnotStyle=1)  # -> Curve, Length, Domain
polyline = PolyLine(Vertices=point, Closed=False)
nurbs_curve = NurbsCurve(Vertices=point, Degree=3, Periodic=False)  # -> Curve, Length, Domain
line_sdl = LineSDL(Start=start, Direction=vector_xyz.Vector, Length=length)
pi = Pi(Factor=range)
j_01_typecheckingspecialconversions = J_01_TypeCheckingSpecialConversions()  # -> out, A, B
# ---------- j_01_typecheckingspecialconversions: C# ----------
    Component.Message = "Unboxing conversion";

    double num = 0;
    Point3d myPt = new Point3d();
    Polyline myPolyline = new Polyline(); //creates an empty reference

    //GetType() is a method of every object instance
    Print("Type of val: {0}", val.GetType());
    Print("Type of geometry: {0}", geometry.GetType());

    if(val.GetType() == typeof(int))
      num = (int) val;    // works because you can assign an integer to a double

    if(val is double) //another way of checking if unboxing would succeed
      num = (double) val;

    if(geometry is Point3d)
    {
      myPt = (Point3d) geometry;
      B = myPt;
    }

    if(geometry is PolylineCurve)
    {
      ((PolylineCurve) geometry).TryGetPolyline(out myPolyline);    // unboxing followed by calling a method to get a Polyline object
      if(myPolyline != null)  //we have to check if reference is not null
        B = myPolyline;
    }

    A = num;
# ---------- end j_01_typecheckingspecialconversions ----------
rotate_3d = Rotate3D(Geometry=nurbs_curve.Curve, Angle=pi, Center=Point(0, 0, 0), Axis=line_sdl)  # -> Geometry, Transform
loft = Loft(
    Curves=rotate_3d.Geometry,
    Options={Adjust=False, Closed=False, LoftEnds=0, LoftSimp=0, LoftType=0, Rebuild=10, Refit=0.01})
