# Grasshopper definition 005_V-Block_6.3.gh (Grasshopper 1.0.7)

construct_point = ConstructPoint(XCoordinate=Slider(0, range=0..10), YCoordinate=Slider(6, range=0..10), ZCoordinate=Slider(7, range=0..10))
number_slider = Slider(1, range=0..1)
list_item = ListItem(List=construct_point, Index=0, Wrap=True)  # -> Item, Item1, Item2
point = Point(list_item.Item)
point_2 = Point([Point(-14.17454343, 0, 0), Point(16, 0, 0), Point(24.0535071, 0, 6.92820323), Point(60, 0, 6.92820323), Point(64, 0, 0), Point(101.7307169, -0.3840564946, -16.15041978), Point(80, 0, 40), Point(72, 0, 40), Point(72, 0, 48), Point(80, 0, 48), Point(115.7901981, 0, 90.58801773), Point(72, 0, 88), Point(45.99968366, 0, 61.99968366), Point(33.99968366, 0, 61.99968366), Point(-954.9939045, 3019.822876, 0), Point(-0.0006326884587, 0, 88), Point(-0.0006326884587, 0, 48), Point(7.999367312, 0, 48), Point(6.009924272, 0, 40), Point(-0.0006326884587, 0, 40)])
cull_index = CullIndex(List=point_2, Indices=Slider(0, range=0..100), Wrap=True)
unit_y = UnitY(Factor=Slider(100, range=0..100))
merge = Merge(Data1=point, Data2=cull_index)  # -> flatten(Result)
polyline = PolyLine(Vertices=merge, Closed=Toggle(True))
extrude = Extrude(Base=polyline, Direction=unit_y)
